# Grasshopper definition DashboardControl.gh (Grasshopper 1.0.7)
# plug-ins: DashboardNXT

number_slider = Slider(50, range=0..1000)
number_slider_2 = Slider(50, range=0..1000)
number_slider_3 = Slider(0, range=0..1000)
controls = ControlPanel(Launch=Button())  # -> Azimuth, Altitude
button = Button()
dom = ConstructDomain(DomainStart=Slider(0, range=0..1000), DomainEnd=Slider(250, range=0..1000))
dom_2 = ConstructDomain(DomainStart=Slider(0, range=0..1000), DomainEnd=Slider(250, range=0..1000))
addition = Addition(A=number_slider, B=Slider(72, range=0..1000))
addition_2 = Addition(A=number_slider_2, B=Slider(30, range=0..1000))
addition_3 = Addition(A=number_slider_3, B=Slider(120, range=0..1000))
controls_2 = ControlPanel(Launch=Button())  # -> Azimuth, Altitude
dom_3 = ConstructDomain(DomainStart=number_slider, DomainEnd=addition)
rectangle = Rectangle(Plane=PlaneXY(0, 0, 0), XSize=dom, YSize=dom_2, Radius=0)  # -> Rectangle, Length
dom_4 = ConstructDomain(DomainStart=number_slider_2, DomainEnd=addition_2)
dom_5 = ConstructDomain(DomainStart=number_slider_3, DomainEnd=addition_3)
box = DomainBox(Base=PlaneXY(0, 0, 0), X=dom_4, Y=dom_3, Z=dom_5)
number_slider_4 = Slider(211, range=0..360)
number_slider_5 = Slider(47, range=0..90)
mbox = MeshBox(Base=box, XCount=Slider(2, range=0..100), YCount=Slider(2, range=0..100), ZCount=Slider(2, range=0..100))
mplane = MeshPlane(Boundary=rectangle.Rectangle, WidthCount=Slider(50, range=0..100), HeightCount=Slider(50, range=0..100))  # -> Mesh, Area
viewer = DashboardViewer(Launch=Button(), Meshes=flatten([mbox, mplane.Mesh]))
demesh = DeconstructMesh(Mesh=mplane.Mesh)  # -> Vertices, Faces, Colours, Normals
rad = Radians(Degrees=controls_2.Azimuth)
rad_2 = Radians(Degrees=controls_2.Altitude)
pt = PointPolar(BasePlane=PlaneXY(0, 0, 0), XYAngle=rad, ZAngle=rad_2, Offset=1)
rev = Reverse(Vector=pt)
occ = Occlusion(Samples=demesh.Vertices, Obstructions=mbox, Rays=rev)  # -> Hits, Occlusion
addition_4 = Addition(A=occ.Hits, B=1)
sort = SortList(Keys=occ.Hits)  # -> Keys, ValuesA
bnd = Bounds(Numbers=occ.Hits)
dcon = DeleteConsecutive(Set=sort.Keys, Wrap=False)  # -> Set, Count
mindex = MemberIndex(Set=sort.Keys, Member=dcon.Set)  # -> Index, Count
chart = Chart(Toggle=Button(), Values=mindex.Count)
remap = RemapNumbers(Value=occ.Hits, Source=bnd, Target=Domain(0, 1))  # -> Mapped, Clipped
gradient = Gradient(
    LowerLimit=0,
    UpperLimit=1,
    Parameter=remap.Mapped,
    stops=[0: RGB(234, 38, 0), 0.25: RGB(234, 126, 0), 0.5: RGB(254, 244, 84), 0.75: RGB(173, 203, 249), 1: RGB(75, 107, 169)])
mcol = MeshColours(Mesh=mplane.Mesh, Colours=gradient)
