# Grasshopper definition ShadingSample.gh (Grasshopper 1.0.7)

mesh = Mesh(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)
mesh_2 = Mesh(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)
rad = Radians(Degrees=Slider(211, range=0..360))
rad_2 = Radians(Degrees=Slider(47, range=0..90))
preview = CustomPreview(
    Geometry=mesh_2,
    Material={diffuse=RGB(221, 160, 221), emission=RGB(66, 48, 66), shine=0.5, specular=RGB(255, 255, 255), transparency=0})
demesh = DeconstructMesh(Mesh=mesh)  # -> Vertices, Faces, Colours, Normals
pt = PointPolar(BasePlane=PlaneXY(0, 0, 0), XYAngle=rad, ZAngle=rad_2, Offset=1)
rev = Reverse(Vector=pt)
occ = Occlusion(Samples=demesh.Vertices, Obstructions=mesh_2, Rays=rev)  # -> Hits, Occlusion
bnd = Bounds(Numbers=occ.Hits)
remap = RemapNumbers(Value=occ.Hits, Source=bnd, Target=Domain(0, 1))  # -> Mapped, Clipped
gradient = Gradient(
    LowerLimit=0,
    UpperLimit=1,
    Parameter=remap.Mapped,
    stops=[0: RGB(234, 38, 0), 0.25: RGB(234, 126, 0), 0.5: RGB(254, 244, 84), 0.75: RGB(173, 203, 249), 1: RGB(75, 107, 169)])
mcol = MeshColours(Mesh=mesh, Colours=gradient)
